# Grasshopper definition building_generator.gh (Grasshopper 1.0.7)

# ---- group: Transformation rules
ground_floor_rotate_angle = Slider(0, range=-2..2)
ground_floor_scale_factor = Slider(1, range=0.5..1.5)
roof_rotate_angle = Slider(0, range=-2..2)
roof_scale_factor = Slider(1, range=0.5..1.5)

# ---- group: Genes
building_storey = Slider(20, range=20..30)
floor_height = Slider(5, range=4..6)
ground_floor_geometry = Curve(<curve referenced from the Rhino model>)

# ---- group: Gorund floor center point
ground_floor_geometry_2 = Curve(ground_floor_geometry)
topoly = CurveToPolyline(Curve=ground_floor_geometry_2, ToleranceDistance=0, ToleranceAngle=0)  # -> Polyline, Segments
pcen = PolygonCenter(Polyline=topoly.Polyline)  # -> CenterV, CenterE, CenterA
gf_center_point = Point(pcen.CenterA)

# ---- group: Building height
building_storey_2 = Number(building_storey)
floor_height_2 = Number(floor_height)
multiplication = Multiplication(BuildingStorey=building_storey_2, FloorHeight=floor_height_2)
building_height = Number(multiplication)
panel = Panel(building_height)

# ---- group: Ground floor geometry scale
gf_center_point_2 = Point(gf_center_point)
ground_floor_scale_factor_2 = Number(ground_floor_scale_factor)
crv = Curve(ground_floor_geometry)
scale = Scale(Geometry=crv, Center=gf_center_point_2, Factor=ground_floor_scale_factor_2)  # -> Geometry, Transform

# ---- group: Roof center point
building_height_2 = Number(panel)
ground_floor_geometry_3 = Curve(ground_floor_geometry)
Z = UnitZ(Factor=building_height_2)
move = Move(Geometry=ground_floor_geometry_3, Motion=Z)  # -> Geometry, Transform
pcen_2 = PolygonCenter(Polyline=move.Geometry)  # -> CenterV, CenterE, CenterA
roof_center_point_plane = Point(pcen_2.CenterA)

# ---- group: Roof geometry scale
roof_center_point = Point(roof_center_point_plane)
roof_scale_factor_2 = Number(roof_scale_factor)
crv_2 = Curve(move.Geometry)
scale_2 = Scale(Geometry=crv_2, Center=roof_center_point, Factor=roof_scale_factor_2)  # -> Geometry, Transform

# ---- group: Roof geometry rotate
roof_rotate_angle_2 = Number(roof_rotate_angle)
roof_plane = Plane(roof_center_point_plane)
rotate = Rotate(Geometry=scale_2.Geometry, Angle=roof_rotate_angle_2, Plane=roof_plane)  # -> Geometry, Transform

# ---- group: Ground floor geometry rotate
gf_center_point_3 = Point(gf_center_point)
num = Number(ground_floor_rotate_angle)
rotate_2 = Rotate(Geometry=scale.Geometry, Angle=num, Plane=gf_center_point_3)  # -> Geometry, Transform

# ---- group: Building mass
ground_floor = Curve(rotate_2.Geometry)
roof = Curve(rotate.Geometry)
loft = Loft(
    Curves=[roof, ground_floor],
    Options={Adjust=False, Closed=False, LoftEnds=0, LoftSimp=0, LoftType=0, Rebuild=10, Refit=0.01})
cap = CapHoles(Brep=loft)
preview = CustomPreview(Geometry=cap, Material=ColourSwatch(SwatchColor=RGB(176, 255, 229)))

# ---- group: Floors
building_mass = Brep(cap)
floor_height_3 = Number(floor_height)
contour = Contour(Shape=building_mass, Point=Point(0, 0, 0), Direction=Vector(0, 0, 1), Distance=floor_height_3)  # -> flatten(Contours)
area = Area(Geometry=contour)  # -> Area, Centroid
ma = MassAddition(Input=area.Area)  # -> Result, PartialResults
panel_2 = Panel(ma.Result)
panel_3 = Panel(area.Area)

# ---- group: Ground floor area
ground_floor_geometry_4 = Curve(ground_floor_geometry)
area_2 = Area(Geometry=ground_floor_geometry_4)  # -> BuildingArea, Centroid

# ----
building_area = Number(area_2.BuildingArea)

# ---- group: Ground floor area (continued)
panel_4 = Panel(building_area)
